# Grasshopper definition measure_bending_angle.gh (Grasshopper 1.0.7)

# ---- group: frame
crv = Curve([<curve referenced from the Rhino model> x9])

# ---- group: samples
crv_2 = Curve([<curve referenced from the Rhino model> x4])

# ----
end = EndPoints(Curve=crv)  # -> Start, End
range = Range(Domain=Domain(0, 1), Steps=Slider(17, range=0..100))
sort_pt = SortPoints(Points=end.Start)  # -> Points, Indices
toggle = BooleanToggle(False)
rev = ReverseList(List=sort_pt.Indices)
end_2 = EndPoints(Curve=crv_2)  # -> Start, End
item = ListItem(List=crv, Index=rev, Wrap=True)  # -> simplify(Item)
incurve = PointInCurve(Point=end_2.Start, Curve=graft(item))  # -> simplify(Relationship), Point
equals = Equality(FirstNumber=incurve.Relationship, SecondNumber=2)  # -> Equality, Inequality
dispatch = Dispatch(List=crv_2, DispatchPattern=equals.Equality)  # -> ListA, ListB
end_3 = EndPoints(Curve=dispatch.ListA)  # -> Start, End
sort_pt_2 = SortPoints(Points=end_3.Start)  # -> Points, Indices
y = Slider(1, range=0..20)  # disabled
x = Slider(1, range=0..20)  # disabled
item_2 = ListItem(List=dispatch.ListA, Index=sort_pt_2.Indices, Wrap=True)  # -> simplify(Item)
crv_3 = Curve(graft(item_2))
crvgraph = CurvatureGraph(Curve=crv_3, Density=5, Scale=105)
planar = Planar(Curve=crv_3)  # -> Planar, Plane, Deviation
pframe = PerpFrame(Curve=reparameterize(crv_3), Parameter=range)
deplane = DeconstructPlane(Plane=pframe)  # -> Origin, XAxis, YAxis, ZAxis
shift = ShiftList(List=simplify(deplane.XAxis), Shift="-1", Wrap=toggle)
shift_2 = ShiftList(List=simplify(deplane.XAxis), Shift=1, Wrap=toggle)
angle = Angle(VectorA=shift, VectorB=shift_2, Plane=planar.Plane)  # -> Angle, Reflex
ma = MassAddition(Input=angle.Angle)  # -> simplify(Result), PartialResults
panel = Panel(ma.Result)
expression = Expression(x=ma.Result, Expression="x/(2*pi)*360")
path_mapper = PathMapper(ma.Result, source="{A;B}", target="{A}")
lng = ListLength(List=item_2)
tstat = TreeStatistics(Tree=item_2)  # -> simplify(graft(Paths)), Length, Count
series = Series(Start=0, Step=1, Count=lng)  # -> simplify(graft(Series))
item_3 = TreeItem(Tree=item_2, Path=y, Index=x, Wrap=True)  # disabled
join = TextJoin(Text=path_mapper, Join=",")
panel_2 = Panel(path_mapper)
dup = DuplicateData(Data=tstat.Paths, Number=lng, Order=True)  # -> simplify(graft(Data))
format = Format(Format="{0:0}", Culture=127, Data0=series)
join_2 = TextJoin(Text=[dup, format])
panel_3 = Panel(join_2)
path_mapper_2 = PathMapper(join_2, source="{A;B}", target="{A}")
end_4 = EndPoints(Curve=item_2)  # -> Start, End
tag = TextTag(Location=end_4.Start, Text=path_mapper_2)
